# Grasshopper definition 202203.24_aftertiral_BMC_SK.gh (Grasshopper 1.0.7)
# plug-ins: Anemone, Pufferfish, EleFront

crv = Curve(<curve referenced from the Rhino model>)
brep = Brep(<brep referenced from the Rhino model>)
pt = Point(<point referenced from the Rhino model>)
join = JoinCurves(Curves=crv, Preserve=False)
end = EndPoints(Curve=join)  # -> Start, End
move2pt = MoveToPoint(Geometry=brep, PointA=pt, PointB=end.Start)  # -> Moved, Vector, Transform
number_slider = Slider(90, range=0..100)
swp1 = Sweep1(Rail=join, Sections=move2pt.Moved, Miter=1)
number_slider_2 = Slider(270, range=0..1000)
rotate = Rotate(Geometry=swp1, Angle=degrees(Slider(180, range=0..1000)), Plane=end.Start)  # -> Geometry, Transform

crv_2 = Curve(<curve referenced from the Rhino model>)
brep_2 = Brep(<brep referenced from the Rhino model>)
pt_2 = Point(<point referenced from the Rhino model>)
join_2 = JoinCurves(Curves=crv_2, Preserve=False)
end_2 = EndPoints(Curve=join_2)  # -> Start, End
move2pt_2 = MoveToPoint(Geometry=brep_2, PointA=pt_2, PointB=end_2.Start)  # -> Moved, Vector, Transform
swp1_2 = Sweep1(Rail=join_2, Sections=move2pt_2.Moved, Miter=1)
number_slider_3 = Slider(180, range=0..1000)
# 8.
number_slider_4 = Slider(270, range=0..1000)
rotate_2 = Rotate(Geometry=swp1_2, Angle=degrees(Slider(90, range=0..100)), Plane=end_2.Start)  # -> Geometry, Transform

# ----
# All
# starting point
brep_3 = Brep([<brep referenced from the Rhino model> x168])
pt_3 = Point(<point referenced from the Rhino model>)
volume = Volume(Geometry=brep_3)  # -> Volume, Centroid
list = ValueList({"Default", "Door", "Guide", "Guide::CubeFrame", "Guide::foundation", "Guide::Guide_Cage", "Guide::Guide_Geo", "Guide::Guide_Pt", "Guide::Guide_Text", "Guide::Octant Box", "Guide::window", "Slab", "Window_select1"}, selected="Door")
list_2 = ValueList({"Default", "Door", "Guide", "Guide::CubeFrame", "Guide::foundation", "Guide::Guide_Cage", "Guide::Guide_Geo", "Guide::Guide_Pt", "Guide::Guide_Text", "Guide::Octant Box", "Guide::window", "Slab", "Window_select1"}, selected="Window_select1")
list_3 = ValueList({"Default", "Door", "Guide", "Guide::CubeFrame", "Guide::foundation", "Guide::Guide_Cage", "Guide::Guide_Geo", "Guide::Guide_Pt", "Guide::Guide_Text", "Guide::Octant Box", "Guide::window", "Slab", "Window_select1"}, selected="Slab")
cluster = Cluster(C=volume.Centroid, B=pt_3)  # -> G, G_2, number_slider_3
filterlay = FilterByLayer(Geometry=brep_3, Layer=list_2)
filterlay_2 = FilterByLayer(Geometry=brep_3, Layer=list_3)
filterlay_3 = FilterByLayer(Geometry=brep_3, Layer=list)
volume_2 = Volume(Geometry=filterlay_2)  # -> Volume, Centroid
volume_3 = Volume(Geometry=filterlay)  # -> Volume, Centroid
volume_4 = Volume(Geometry=filterlay_3)  # -> Volume, Centroid
wires = BrepWireframe(Brep=cluster.G, Density=-1)

# ---- group: LOOP START
lng = ListLength(List=cluster.G)  # -> expr("x-1", Length)
loop_start = LoopStart(Repeat=lng, Trigger=Toggle(False))  # -> port, Counter, Data

# ----
item = ListItem(List=cluster.G, Index=Slider(90, range=0..314), Wrap=True)
box = EvaluateBox(Box=item, UParameter=0.5, VParameter=0.5, WParameter=0.5)  # -> Plane, Point, Include

# ---- group: IMAGINARY CUBES
wires_2 = BrepWireframe(Brep=item, Density=-1)
preview = CustomPreview(Geometry=wires_2, Material=ColourSwatch(SwatchColor=RGB(247, 4, 0)))

# ----
box_corners = BoxCorners(Box=item)  # -> CornerA, CornerB, CornerC, CornerD, CornerE, CornerF, CornerG, CornerH
merge = Merge(
    Data1=box_corners.CornerA,
    Data2=box_corners.CornerB,
    Data3=box_corners.CornerC,
    Data4=box_corners.CornerD,
    Data5=box_corners.CornerE,
    Data6=box_corners.CornerF,
    Data7=box_corners.CornerG,
    Data8=box_corners.CornerH)
cp = ClosestPoint(Point=graft(merge), Cloud=volume.Centroid)  # -> ClosestPoint, CPIndex, Distance
cp_2 = ClosestPoint(Point=graft(merge), Cloud=volume_3.Centroid)  # -> ClosestPoint, CPIndex, Distance
cp_3 = ClosestPoint(Point=graft(merge), Cloud=volume_2.Centroid)  # -> ClosestPoint, CPIndex, Distance
cp_4 = ClosestPoint(Point=graft(merge), Cloud=volume_4.Centroid)  # -> ClosestPoint, CPIndex, Distance

# ---- group: Getting bottom verices
item_2 = ListItem(List=flatten(cluster.G_2), Index=Slider(1, range=0..100), Wrap=True)
ungroup = Ungroup(Group=item_2)
box_corners_2 = BoxCorners(Box=flatten(ungroup))  # -> CornerA, CornerB, CornerC, CornerD, CornerE, CornerF, CornerG, CornerH
merge_2 = Merge(Data1=box_corners_2.CornerA, Data2=box_corners_2.CornerB, Data3=box_corners_2.CornerC, Data4=box_corners_2.CornerD)
mindex = MemberIndex(Set=merge_2, Member=merge)  # -> Index, Count

# ----
smaller = SmallerThan(FirstNumber=cp_2.Distance, SecondNumber="0.1")  # -> SmallerThan, flatten(OrEqualTo)
smaller_2 = SmallerThan(FirstNumber=cp_3.Distance, SecondNumber="0.1")  # -> SmallerThan, flatten(OrEqualTo)
smaller_3 = SmallerThan(FirstNumber=cp.Distance, SecondNumber="0.1")  # -> SmallerThan, flatten(OrEqualTo)
smaller_4 = SmallerThan(FirstNumber=cp_4.Distance, SecondNumber="0.1")  # -> SmallerThan, flatten(OrEqualTo)
bool = Boolean(smaller.OrEqualTo)
bool_2 = Boolean(smaller_3.OrEqualTo)
bool_3 = Boolean(smaller_2.OrEqualTo)
bool_4 = Boolean(smaller_4.OrEqualTo)

# ---- group: Getting GREEN (SLAB) vertices
mindex_2 = MemberIndex(Set=volume_2.Centroid, Member=merge)  # -> Index, Count

# ----
mindex_3 = MemberIndex(Set=volume_3.Centroid, Member=merge)  # -> Index, Count
ma = MassAddition(Input=mindex.Count)  # -> Result, PartialResults
larger = LargerThan(FirstNumber=ma.Result, SecondNumber=Slider(1, range=0..1))  # -> LargerThan, flatten(OrEqualTo)

# ----
# Cantilever
cage_crv = Curve([<curve referenced from the Rhino model> x6])
guiding_pts = Point(<point referenced from the Rhino model>)
element_geo = Geometry([<brep referenced from the Rhino model> x2])
explode = Explode(Curve=cage_crv, Recursive=True)  # -> flatten(Segments), Vertices
tile_var = Cluster2(crv=explode.Segments, pt=guiding_pts, O=element_geo)  # -> smaller_than, O_2, O_3, G
origin_pt_tile_geo = Geometry(tile_var.G)
guide_pts = Point(tile_var.O_3)
rules_0_1 = Boolean(tile_var.smaller_than)
bbox_crvs = Curve(tile_var.O_2)
equals = Equality(FirstNumber=bool_2, SecondNumber=rules_0_1)  # -> Equality, Inequality
ma_2 = MassAddition(Input=equals.Equality)  # -> Result, PartialResults
equals_2 = Equality(FirstNumber=ma_2.Result, SecondNumber="8")  # -> Equality, Inequality
p_n_c = PickNChoose(Pattern=equals_2.Equality, Stream1=origin_pt_tile_geo)  # -> flatten(Result)
clean = CleanTree(RemoveNulls=True, RemoveInvalid=True, RemoveEmpty=False, Tree=p_n_c)

# ----
# Top connect
cage_crv_2 = Curve([<curve referenced from the Rhino model> x6])
guiding_pts_2 = Point([<point referenced from the Rhino model> x5])
element_geo_2 = Geometry([<brep referenced from the Rhino model> x2])
explode_2 = Explode(Curve=cage_crv_2, Recursive=True)  # -> flatten(Segments), Vertices
tile_var_2 = Cluster2(crv=explode_2.Segments, pt=guiding_pts_2, O=element_geo_2)  # -> smaller_than, O_2, O_3, G
origin_pt_tile_geo_2 = Geometry(tile_var_2.G)
guide_pts_2 = Point(tile_var_2.O_3)
rules_0_1_2 = Boolean(tile_var_2.smaller_than)
bbox_crvs_2 = Curve(tile_var_2.O_2)
equals_3 = Equality(FirstNumber=bool_2, SecondNumber=rules_0_1_2)  # -> Equality, Inequality
ma_3 = MassAddition(Input=equals_3.Equality)  # -> Result, PartialResults
equals_4 = Equality(FirstNumber=ma_3.Result, SecondNumber="8")  # -> Equality, Inequality
p_n_c_2 = PickNChoose(Pattern=equals_4.Equality, Stream1=origin_pt_tile_geo_2)  # -> flatten(Result)
clean_2 = CleanTree(RemoveNulls=True, RemoveInvalid=True, RemoveEmpty=False, Tree=p_n_c_2)

cage_crv_3 = Curve([<curve referenced from the Rhino model> x6])
guiding_pts_3 = Point([<point referenced from the Rhino model> x3])
element_geo_3 = Geometry([<brep referenced from the Rhino model> x2])
explode_3 = Explode(Curve=cage_crv_3, Recursive=True)  # -> flatten(Segments), Vertices
tile_var_3 = Cluster2(crv=explode_3.Segments, pt=guiding_pts_3, O=element_geo_3)  # -> smaller_than, O_2, O_3, G
origin_pt_tile_geo_3 = Geometry(tile_var_3.G)
guide_pts_3 = Point(tile_var_3.O_3)
rules_0_1_3 = Boolean(tile_var_3.smaller_than)
bbox_crvs_3 = Curve(tile_var_3.O_2)
equals_5 = Equality(FirstNumber=bool_2, SecondNumber=rules_0_1_3)  # -> Equality, Inequality
ma_4 = MassAddition(Input=equals_5.Equality)  # -> Result, PartialResults
equals_6 = Equality(FirstNumber=ma_4.Result, SecondNumber="8")  # -> Equality, Inequality
p_n_c_3 = PickNChoose(Pattern=equals_6.Equality, Stream1=origin_pt_tile_geo_3)  # -> flatten(Result)
clean_3 = CleanTree(RemoveNulls=True, RemoveInvalid=True, RemoveEmpty=False, Tree=p_n_c_3)

cage_crv_4 = Curve([<curve referenced from the Rhino model> x6])
guiding_pts_4 = Point([<point referenced from the Rhino model> x7])
element_geo_4 = Geometry(<brep referenced from the Rhino model>)
explode_4 = Explode(Curve=cage_crv_4, Recursive=True)  # -> flatten(Segments), Vertices
tile_var_4 = Cluster2(crv=explode_4.Segments, pt=guiding_pts_4, O=element_geo_4)  # -> smaller_than, O_2, O_3, G
origin_pt_tile_geo_4 = Geometry(tile_var_4.G)
guide_pts_4 = Point(tile_var_4.O_3)
rules_0_1_4 = Boolean(tile_var_4.smaller_than)
bbox_crvs_4 = Curve(tile_var_4.O_2)
equals_7 = Equality(FirstNumber=bool_2, SecondNumber=rules_0_1_4)  # -> Equality, Inequality
ma_5 = MassAddition(Input=equals_7.Equality)  # -> Result, PartialResults
equals_8 = Equality(FirstNumber=ma_5.Result, SecondNumber="8")  # -> Equality, Inequality
p_n_c_4 = PickNChoose(Pattern=equals_8.Equality, Stream1=origin_pt_tile_geo_4)  # -> flatten(Result)
clean_4 = CleanTree(RemoveNulls=True, RemoveInvalid=True, RemoveEmpty=False, Tree=p_n_c_4)

cage_crv_5 = Curve([<curve referenced from the Rhino model> x6])
guiding_pts_5 = Point([<point referenced from the Rhino model> x2])
element_geo_5 = Geometry([<brep referenced from the Rhino model> x2])
explode_5 = Explode(Curve=cage_crv_5, Recursive=True)  # -> flatten(Segments), Vertices
tile_var_5 = Cluster2(crv=explode_5.Segments, pt=guiding_pts_5, O=element_geo_5)  # -> smaller_than, O_2, O_3, G
origin_pt_tile_geo_5 = Geometry(tile_var_5.G)
guide_pts_5 = Point(tile_var_5.O_3)
rules_0_1_5 = Boolean(tile_var_5.smaller_than)
bbox_crvs_5 = Curve(tile_var_5.O_2)
equals_9 = Equality(FirstNumber=bool_2, SecondNumber=rules_0_1_5)  # -> Equality, Inequality
ma_6 = MassAddition(Input=equals_9.Equality)  # -> Result, PartialResults
equals_10 = Equality(FirstNumber=ma_6.Result, SecondNumber="8")  # -> Equality, Inequality
p_n_c_5 = PickNChoose(Pattern=equals_10.Equality, Stream1=origin_pt_tile_geo_5)  # -> flatten(Result)
clean_5 = CleanTree(RemoveNulls=True, RemoveInvalid=True, RemoveEmpty=False, Tree=p_n_c_5)

cage_crv_6 = Curve([<curve referenced from the Rhino model> x6])
guiding_pts_6 = Point([<point referenced from the Rhino model> x6])
element_geo_6 = Geometry(<brep referenced from the Rhino model>)
explode_6 = Explode(Curve=cage_crv_6, Recursive=True)  # -> flatten(Segments), Vertices
tile_var_6 = Cluster2(crv=explode_6.Segments, pt=guiding_pts_6, O=element_geo_6)  # -> smaller_than, O_2, O_3, G
origin_pt_tile_geo_6 = Geometry(tile_var_6.G)
guide_pts_6 = Point(tile_var_6.O_3)
rules_0_1_6 = Boolean(tile_var_6.smaller_than)
bbox_crvs_6 = Curve(tile_var_6.O_2)
equals_11 = Equality(FirstNumber=bool_2, SecondNumber=rules_0_1_6)  # -> Equality, Inequality
ma_7 = MassAddition(Input=equals_11.Equality)  # -> Result, PartialResults
equals_12 = Equality(FirstNumber=ma_7.Result, SecondNumber="8")  # -> Equality, Inequality
p_n_c_6 = PickNChoose(Pattern=equals_12.Equality, Stream1=origin_pt_tile_geo_6)  # -> flatten(Result)
clean_6 = CleanTree(RemoveNulls=True, RemoveInvalid=True, RemoveEmpty=False, Tree=p_n_c_6)

cage_crv_7 = Curve([<curve referenced from the Rhino model> x6])
guiding_pts_7 = Point([<point referenced from the Rhino model> x4])
element_geo_7 = Geometry([<brep referenced from the Rhino model> x2])
explode_7 = Explode(Curve=cage_crv_7, Recursive=True)  # -> flatten(Segments), Vertices
tile_var_7 = Cluster22(crv=explode_7.Segments, pt=guiding_pts_7, G=element_geo_7)  # -> crv_3, smaller_than, O, G_2
guide_pts_7 = Point(tile_var_7.O)
bbox_crvs_7 = Curve(tile_var_7.crv_3)
origin_pt_tile_geo_7 = Geometry(tile_var_7.G_2)
rules_0_1_7 = Boolean(tile_var_7.smaller_than)
equals_13 = Equality(FirstNumber=bool_2, SecondNumber=rules_0_1_7)  # -> Equality, Inequality
ma_8 = MassAddition(Input=equals_13.Equality)  # -> Result, PartialResults
equals_14 = Equality(FirstNumber=ma_8.Result, SecondNumber="8")  # -> Equality, Inequality
p_n_c_7 = PickNChoose(Pattern=equals_14.Equality, Stream1=origin_pt_tile_geo_7)  # -> flatten(Result)
clean_7 = CleanTree(RemoveNulls=True, RemoveInvalid=True, RemoveEmpty=False, Tree=p_n_c_7)

# ----
# top tiles
cage_crv_8 = Curve([<curve referenced from the Rhino model> x6])
guiding_pts_8 = Point(<point referenced from the Rhino model>)
element_geo_8 = Geometry([<brep referenced from the Rhino model> x2])
explode_8 = Explode(Curve=cage_crv_8, Recursive=True)  # -> flatten(Segments), Vertices
tile_var_8 = Cluster2(crv=explode_8.Segments, pt=guiding_pts_8, O=element_geo_8)  # -> smaller_than, O_2, O_3, G
origin_pt_tile_geo_8 = Geometry(tile_var_8.G)
guide_pts_8 = Point(tile_var_8.O_3)
rules_0_1_8 = Boolean(tile_var_8.smaller_than)
bbox_crvs_8 = Curve(tile_var_8.O_2)
equals_15 = Equality(FirstNumber=bool_2, SecondNumber=rules_0_1_8)  # -> Equality, Inequality
ma_9 = MassAddition(Input=equals_15.Equality)  # -> Result, PartialResults
equals_16 = Equality(FirstNumber=ma_9.Result, SecondNumber="8")  # -> Equality, Inequality
p_n_c_8 = PickNChoose(Pattern=equals_16.Equality, Stream1=origin_pt_tile_geo_8)  # -> flatten(Result)
clean_8 = CleanTree(RemoveNulls=True, RemoveInvalid=True, RemoveEmpty=False, Tree=p_n_c_8)

cage_crv_9 = Curve([<curve referenced from the Rhino model> x6])
guiding_pts_9 = Point([<point referenced from the Rhino model> x3])
element_geo_9 = Geometry([<brep referenced from the Rhino model> x2])
explode_9 = Explode(Curve=cage_crv_9, Recursive=True)  # -> flatten(Segments), Vertices
tile_var_9 = Cluster2(crv=explode_9.Segments, pt=guiding_pts_9, O=element_geo_9)  # -> smaller_than, O_2, O_3, G
origin_pt_tile_geo_9 = Geometry(tile_var_9.G)
guide_pts_9 = Point(tile_var_9.O_3)
rules_0_1_9 = Boolean(tile_var_9.smaller_than)
bbox_crvs_9 = Curve(tile_var_9.O_2)
equals_17 = Equality(FirstNumber=bool_2, SecondNumber=rules_0_1_9)  # -> Equality, Inequality
ma_10 = MassAddition(Input=equals_17.Equality)  # -> Result, PartialResults
equals_18 = Equality(FirstNumber=ma_10.Result, SecondNumber="8")  # -> Equality, Inequality
p_n_c_9 = PickNChoose(Pattern=equals_18.Equality, Stream1=origin_pt_tile_geo_9)  # -> flatten(Result)
clean_9 = CleanTree(RemoveNulls=True, RemoveInvalid=True, RemoveEmpty=False, Tree=p_n_c_9)

cage_crv_10 = Curve([<curve referenced from the Rhino model> x6])
guiding_pts_10 = Point([<point referenced from the Rhino model> x2])
element_geo_10 = Geometry([<brep referenced from the Rhino model> x2])
explode_10 = Explode(Curve=cage_crv_10, Recursive=True)  # -> flatten(Segments), Vertices
tile_var_10 = Cluster2(crv=explode_10.Segments, pt=guiding_pts_10, O=element_geo_10)  # -> smaller_than, O_2, O_3, G
origin_pt_tile_geo_10 = Geometry(tile_var_10.G)
guide_pts_10 = Point(tile_var_10.O_3)
rules_0_1_10 = Boolean(tile_var_10.smaller_than)
bbox_crvs_10 = Curve(tile_var_10.O_2)
equals_19 = Equality(FirstNumber=bool_2, SecondNumber=rules_0_1_10)  # -> Equality, Inequality
ma_11 = MassAddition(Input=equals_19.Equality)  # -> Result, PartialResults
equals_20 = Equality(FirstNumber=ma_11.Result, SecondNumber="8")  # -> Equality, Inequality
p_n_c_10 = PickNChoose(Pattern=equals_20.Equality, Stream1=origin_pt_tile_geo_10)  # -> flatten(Result)
clean_10 = CleanTree(RemoveNulls=True, RemoveInvalid=True, RemoveEmpty=False, Tree=p_n_c_10)

cage_crv_11 = Curve([<curve referenced from the Rhino model> x6])
guiding_pts_11 = Point([<point referenced from the Rhino model> x4])
element_geo_11 = Geometry(<brep referenced from the Rhino model>)
explode_11 = Explode(Curve=cage_crv_11, Recursive=True)  # -> flatten(Segments), Vertices
tile_var_11 = Cluster22(crv=explode_11.Segments, pt=guiding_pts_11, G=element_geo_11)  # -> crv_3, smaller_than, O, G_2
origin_pt_tile_geo_11 = Geometry(tile_var_11.G_2)
guide_pts_11 = Point(tile_var_11.O)
rules_0_1_11 = Boolean(tile_var_11.smaller_than)
bbox_crvs_11 = Curve(tile_var_11.crv_3)
equals_21 = Equality(FirstNumber=bool_2, SecondNumber=rules_0_1_11)  # -> Equality, Inequality
ma_12 = MassAddition(Input=equals_21.Equality)  # -> Result, PartialResults
equals_22 = Equality(FirstNumber=ma_12.Result, SecondNumber="8")  # -> Equality, Inequality
p_n_c_11 = PickNChoose(Pattern=equals_22.Equality, Stream1=origin_pt_tile_geo_11)  # -> flatten(Result)
clean_11 = CleanTree(RemoveNulls=True, RemoveInvalid=True, RemoveEmpty=False, Tree=p_n_c_11)

cage_crv_12 = Curve([<curve referenced from the Rhino model> x6])
guiding_pts_12 = Point([<point referenced from the Rhino model> x5])
element_geo_12 = Geometry([<brep referenced from the Rhino model> x5])
explode_12 = Explode(Curve=cage_crv_12, Recursive=True)  # -> flatten(Segments), Vertices
tile_var_12 = Cluster2(crv=explode_12.Segments, pt=guiding_pts_12, O=element_geo_12)  # -> smaller_than, O_2, O_3, G
origin_pt_tile_geo_12 = Geometry(tile_var_12.G)
guide_pts_12 = Point(tile_var_12.O_3)
rules_0_1_12 = Boolean(tile_var_12.smaller_than)
bbox_crvs_12 = Curve(tile_var_12.O_2)
equals_23 = Equality(FirstNumber=bool_2, SecondNumber=rules_0_1_12)  # -> Equality, Inequality
ma_13 = MassAddition(Input=equals_23.Equality)  # -> Result, PartialResults
equals_24 = Equality(FirstNumber=ma_13.Result, SecondNumber="8")  # -> Equality, Inequality
p_n_c_12 = PickNChoose(Pattern=equals_24.Equality, Stream1=origin_pt_tile_geo_12)  # -> flatten(Result)
clean_12 = CleanTree(RemoveNulls=True, RemoveInvalid=True, RemoveEmpty=False, Tree=p_n_c_12)

cage_crv_13 = Curve([<curve referenced from the Rhino model> x6])
guiding_pts_13 = Point([<point referenced from the Rhino model> x6])
element_geo_13 = Geometry([<brep referenced from the Rhino model> x2])
explode_13 = Explode(Curve=cage_crv_13, Recursive=True)  # -> flatten(Segments), Vertices
tile_var_13 = Cluster2(crv=explode_13.Segments, pt=guiding_pts_13, O=element_geo_13)  # -> smaller_than, O_2, O_3, G
origin_pt_tile_geo_13 = Geometry(tile_var_13.G)
guide_pts_13 = Point(tile_var_13.O_3)
rules_0_1_13 = Boolean(tile_var_13.smaller_than)
bbox_crvs_13 = Curve(tile_var_13.O_2)
equals_25 = Equality(FirstNumber=bool_2, SecondNumber=rules_0_1_13)  # -> Equality, Inequality
ma_14 = MassAddition(Input=equals_25.Equality)  # -> Result, PartialResults
equals_26 = Equality(FirstNumber=ma_14.Result, SecondNumber="8")  # -> Equality, Inequality
p_n_c_13 = PickNChoose(Pattern=equals_26.Equality, Stream1=origin_pt_tile_geo_13)  # -> flatten(Result)
clean_13 = CleanTree(RemoveNulls=True, RemoveInvalid=True, RemoveEmpty=False, Tree=p_n_c_13)

cage_crv_14 = Curve([<curve referenced from the Rhino model> x6])
guiding_pts_14 = Point([<point referenced from the Rhino model> x6])
element_geo_14 = Geometry([<brep referenced from the Rhino model> x2])
explode_14 = Explode(Curve=cage_crv_14, Recursive=True)  # -> flatten(Segments), Vertices
tile_var_14 = Cluster2(crv=explode_14.Segments, pt=guiding_pts_14, O=element_geo_14)  # -> smaller_than, O_2, O_3, G
origin_pt_tile_geo_14 = Geometry(tile_var_14.G)
guide_pts_14 = Point(tile_var_14.O_3)
rules_0_1_14 = Boolean(tile_var_14.smaller_than)
bbox_crvs_14 = Curve(tile_var_14.O_2)
equals_27 = Equality(FirstNumber=bool_2, SecondNumber=rules_0_1_14)  # -> Equality, Inequality
ma_15 = MassAddition(Input=equals_27.Equality)  # -> Result, PartialResults
equals_28 = Equality(FirstNumber=ma_15.Result, SecondNumber="8")  # -> Equality, Inequality
p_n_c_14 = PickNChoose(Pattern=equals_28.Equality, Stream1=origin_pt_tile_geo_14)  # -> flatten(Result)
clean_14 = CleanTree(RemoveNulls=True, RemoveInvalid=True, RemoveEmpty=False, Tree=p_n_c_14)

cage_crv_15 = Curve([<curve referenced from the Rhino model> x6])
guiding_pts_15 = Point([<point referenced from the Rhino model> x3])
element_geo_15 = Geometry([<brep referenced from the Rhino model> x4])
explode_15 = Explode(Curve=cage_crv_15, Recursive=True)  # -> flatten(Segments), Vertices
tile_var_mirror = Cluster2_2(crv=explode_15.Segments, pt=guiding_pts_15, O=element_geo_15)  # -> smaller_than, O_2, O_3, G
origin_pt_tile_geo_15 = Geometry(tile_var_mirror.G)
guide_pts_15 = Point(tile_var_mirror.O_3)
rules_0_1_15 = Boolean(tile_var_mirror.smaller_than)
bbox_crvs_15 = Curve(tile_var_mirror.O_2)
equals_29 = Equality(FirstNumber=bool_2, SecondNumber=rules_0_1_15)  # -> Equality, Inequality
ma_16 = MassAddition(Input=equals_29.Equality)  # -> Result, PartialResults
equals_30 = Equality(FirstNumber=ma_16.Result, SecondNumber="8")  # -> Equality, Inequality
p_n_c_15 = PickNChoose(Pattern=equals_30.Equality, Stream1=origin_pt_tile_geo_15)  # -> flatten(Result)
clean_15 = CleanTree(RemoveNulls=True, RemoveInvalid=True, RemoveEmpty=False, Tree=p_n_c_15)

cage_crv_16 = Curve([<curve referenced from the Rhino model> x6])
guiding_pts_16 = Point([<point referenced from the Rhino model> x3])
element_geo_16 = Geometry([<brep referenced from the Rhino model> x3])
explode_16 = Explode(Curve=cage_crv_16, Recursive=True)  # -> flatten(Segments), Vertices
tile_var_15 = Cluster2(crv=explode_16.Segments, pt=guiding_pts_16, O=element_geo_16)  # -> smaller_than, O_2, O_3, G
origin_pt_tile_geo_16 = Geometry(tile_var_15.G)
guide_pts_16 = Point(tile_var_15.O_3)
rules_0_1_16 = Boolean(tile_var_15.smaller_than)
bbox_crvs_16 = Curve(tile_var_15.O_2)
equals_31 = Equality(FirstNumber=bool_2, SecondNumber=rules_0_1_16)  # -> Equality, Inequality
ma_17 = MassAddition(Input=equals_31.Equality)  # -> Result, PartialResults
equals_32 = Equality(FirstNumber=ma_17.Result, SecondNumber="8")  # -> Equality, Inequality
p_n_c_16 = PickNChoose(Pattern=equals_32.Equality, Stream1=origin_pt_tile_geo_16)  # -> flatten(Result)
clean_16 = CleanTree(RemoveNulls=True, RemoveInvalid=True, RemoveEmpty=False, Tree=p_n_c_16)

cage_crv_17 = Curve([<curve referenced from the Rhino model> x6])
guiding_pts_17 = Point([<point referenced from the Rhino model> x4])
element_geo_17 = Geometry([<brep referenced from the Rhino model> x4])
explode_17 = Explode(Curve=cage_crv_17, Recursive=True)  # -> flatten(Segments), Vertices
tile_var_16 = Cluster2(crv=explode_17.Segments, pt=guiding_pts_17, O=element_geo_17)  # -> smaller_than, O_2, O_3, G
origin_pt_tile_geo_17 = Geometry(tile_var_16.G)
guide_pts_17 = Point(tile_var_16.O_3)
rules_0_1_17 = Boolean(tile_var_16.smaller_than)
bbox_crvs_17 = Curve(tile_var_16.O_2)
equals_33 = Equality(FirstNumber=bool_2, SecondNumber=rules_0_1_17)  # -> Equality, Inequality
ma_18 = MassAddition(Input=equals_33.Equality)  # -> Result, PartialResults
equals_34 = Equality(FirstNumber=ma_18.Result, SecondNumber="8")  # -> Equality, Inequality
p_n_c_17 = PickNChoose(Pattern=equals_34.Equality, Stream1=origin_pt_tile_geo_17)  # -> flatten(Result)
clean_17 = CleanTree(RemoveNulls=True, RemoveInvalid=True, RemoveEmpty=False, Tree=p_n_c_17)

cage_crv_18 = Curve([<curve referenced from the Rhino model> x6])
guiding_pts_18 = Point([<point referenced from the Rhino model> x3])
element_geo_18 = Geometry([<brep referenced from the Rhino model> x3])
explode_18 = Explode(Curve=cage_crv_18, Recursive=True)  # -> flatten(Segments), Vertices
tile_var_17 = Cluster2(crv=explode_18.Segments, pt=guiding_pts_18, O=element_geo_18)  # -> smaller_than, O_2, O_3, G
origin_pt_tile_geo_18 = Geometry(tile_var_17.G)
guide_pts_18 = Point(tile_var_17.O_3)
rules_0_1_18 = Boolean(tile_var_17.smaller_than)
bbox_crvs_18 = Curve(tile_var_17.O_2)
equals_35 = Equality(FirstNumber=bool_2, SecondNumber=rules_0_1_18)  # -> Equality, Inequality
ma_19 = MassAddition(Input=equals_35.Equality)  # -> Result, PartialResults
equals_36 = Equality(FirstNumber=ma_19.Result, SecondNumber="8")  # -> Equality, Inequality
p_n_c_18 = PickNChoose(Pattern=equals_36.Equality, Stream1=origin_pt_tile_geo_18)  # -> flatten(Result)
clean_18 = CleanTree(RemoveNulls=True, RemoveInvalid=True, RemoveEmpty=False, Tree=p_n_c_18)

cage_crv_19 = Curve([<curve referenced from the Rhino model> x6])
guiding_pts_19 = Point([<point referenced from the Rhino model> x5])
element_geo_19 = Geometry([<brep referenced from the Rhino model> x2])
explode_19 = Explode(Curve=cage_crv_19, Recursive=True)  # -> flatten(Segments), Vertices
tile_var_18 = Cluster2(crv=explode_19.Segments, pt=guiding_pts_19, O=element_geo_19)  # -> smaller_than, O_2, O_3, G
origin_pt_tile_geo_19 = Geometry(tile_var_18.G)
guide_pts_19 = Point(tile_var_18.O_3)
rules_0_1_19 = Boolean(tile_var_18.smaller_than)
bbox_crvs_19 = Curve(tile_var_18.O_2)
equals_37 = Equality(FirstNumber=bool_2, SecondNumber=rules_0_1_19)  # -> Equality, Inequality
ma_20 = MassAddition(Input=equals_37.Equality)  # -> Result, PartialResults
equals_38 = Equality(FirstNumber=ma_20.Result, SecondNumber="8")  # -> Equality, Inequality
p_n_c_19 = PickNChoose(Pattern=equals_38.Equality, Stream1=origin_pt_tile_geo_19)  # -> flatten(Result)
clean_19 = CleanTree(RemoveNulls=True, RemoveInvalid=True, RemoveEmpty=False, Tree=p_n_c_19)

# ----
# Bottom wall with edge
cage_crv_20 = Curve([<curve referenced from the Rhino model> x6])
guiding_pts_20 = Point([<point referenced from the Rhino model> x2])
element_geo_20 = Geometry([<brep referenced from the Rhino model> x3])
explode_20 = Explode(Curve=cage_crv_20, Recursive=True)  # -> flatten(Segments), Vertices
tile_var_19 = Cluster2(crv=explode_20.Segments, pt=guiding_pts_20, O=element_geo_20)  # -> smaller_than, O_2, O_3, G
origin_pt_tile_geo_20 = Geometry(tile_var_19.G)
guide_pts_20 = Point(tile_var_19.O_3)
rules_0_1_20 = Boolean(tile_var_19.smaller_than)
bbox_crvs_20 = Curve(tile_var_19.O_2)
equals_39 = Equality(FirstNumber=bool_2, SecondNumber=rules_0_1_20)  # -> Equality, Inequality
ma_21 = MassAddition(Input=equals_39.Equality)  # -> Result, PartialResults
equals_40 = Equality(FirstNumber=ma_21.Result, SecondNumber="8")  # -> Equality, Inequality
p_n_c_20 = PickNChoose(Pattern=equals_40.Equality, Stream1=origin_pt_tile_geo_20)  # -> flatten(Result)
clean_20 = CleanTree(RemoveNulls=True, RemoveInvalid=True, RemoveEmpty=False, Tree=p_n_c_20)

cage_crv_21 = Curve([<curve referenced from the Rhino model> x6])
guiding_pts_21 = Point([<point referenced from the Rhino model> x6])
element_geo_21 = Geometry([<brep referenced from the Rhino model> x3])
explode_21 = Explode(Curve=cage_crv_21, Recursive=True)  # -> flatten(Segments), Vertices
tile_var_20 = Cluster2(crv=explode_21.Segments, pt=guiding_pts_21, O=element_geo_21)  # -> smaller_than, O_2, O_3, G
origin_pt_tile_geo_21 = Geometry(tile_var_20.G)
guide_pts_21 = Point(tile_var_20.O_3)
rules_0_1_21 = Boolean(tile_var_20.smaller_than)
bbox_crvs_21 = Curve(tile_var_20.O_2)
equals_41 = Equality(FirstNumber=bool_2, SecondNumber=rules_0_1_21)  # -> Equality, Inequality
ma_22 = MassAddition(Input=equals_41.Equality)  # -> Result, PartialResults
equals_42 = Equality(FirstNumber=ma_22.Result, SecondNumber="8")  # -> Equality, Inequality
p_n_c_21 = PickNChoose(Pattern=equals_42.Equality, Stream1=origin_pt_tile_geo_21)  # -> flatten(Result)
clean_21 = CleanTree(RemoveNulls=True, RemoveInvalid=True, RemoveEmpty=False, Tree=p_n_c_21)

cage_crv_22 = Curve([<curve referenced from the Rhino model> x6])
guiding_pts_22 = Point([<point referenced from the Rhino model> x4])
element_geo_22 = Geometry([<brep referenced from the Rhino model> x3])
explode_22 = Explode(Curve=cage_crv_22, Recursive=True)  # -> flatten(Segments), Vertices
tile_var_21 = Cluster2(crv=explode_22.Segments, pt=guiding_pts_22, O=element_geo_22)  # -> smaller_than, O_2, O_3, G
origin_pt_tile_geo_22 = Geometry(tile_var_21.G)
guide_pts_22 = Point(tile_var_21.O_3)
rules_0_1_22 = Boolean(tile_var_21.smaller_than)
bbox_crvs_22 = Curve(tile_var_21.O_2)
equals_43 = Equality(FirstNumber=bool_2, SecondNumber=rules_0_1_22)  # -> Equality, Inequality
ma_23 = MassAddition(Input=equals_43.Equality)  # -> Result, PartialResults
equals_44 = Equality(FirstNumber=ma_23.Result, SecondNumber="8")  # -> Equality, Inequality
p_n_c_22 = PickNChoose(Pattern=equals_44.Equality, Stream1=origin_pt_tile_geo_22)  # -> flatten(Result)
clean_22 = CleanTree(RemoveNulls=True, RemoveInvalid=True, RemoveEmpty=False, Tree=p_n_c_22)

# ----
# Bottom tiles
cage_crv_23 = Curve([<curve referenced from the Rhino model> x6])
guiding_pts_23 = Point(<point referenced from the Rhino model>)
element_geo_23 = Geometry([<brep referenced from the Rhino model> x3])
explode_23 = Explode(Curve=cage_crv_23, Recursive=True)  # -> flatten(Segments), Vertices
tile_var_22 = Cluster2(crv=explode_23.Segments, pt=guiding_pts_23, O=element_geo_23)  # -> smaller_than, O_2, O_3, G
origin_pt_tile_geo_23 = Geometry(tile_var_22.G)
guide_pts_23 = Point(tile_var_22.O_3)
rules_0_1_23 = Boolean(tile_var_22.smaller_than)
bbox_crvs_23 = Curve(tile_var_22.O_2)
equals_45 = Equality(FirstNumber=bool_2, SecondNumber=rules_0_1_23)  # -> Equality, Inequality
ma_24 = MassAddition(Input=equals_45.Equality)  # -> Result, PartialResults
equals_46 = Equality(FirstNumber=ma_24.Result, SecondNumber="8")  # -> Equality, Inequality
p_n_c_23 = PickNChoose(Pattern=equals_46.Equality, Stream1=origin_pt_tile_geo_23)  # -> flatten(Result)
clean_23 = CleanTree(RemoveNulls=True, RemoveInvalid=True, RemoveEmpty=False, Tree=p_n_c_23)

merge_3 = Merge(Data1=clean_20, Data2=clean_22, Data3=clean_21)

cage_crv_24 = Curve([<curve referenced from the Rhino model> x6])
guiding_pts_24 = Point([<point referenced from the Rhino model> x3])
element_geo_24 = Geometry([<brep referenced from the Rhino model> x3])
explode_24 = Explode(Curve=cage_crv_24, Recursive=True)  # -> flatten(Segments), Vertices
tile_var_23 = Cluster2(crv=explode_24.Segments, pt=guiding_pts_24, O=element_geo_24)  # -> smaller_than, O_2, O_3, G
origin_pt_tile_geo_24 = Geometry(tile_var_23.G)
guide_pts_24 = Point(tile_var_23.O_3)
rules_0_1_24 = Boolean(tile_var_23.smaller_than)
bbox_crvs_24 = Curve(tile_var_23.O_2)
equals_47 = Equality(FirstNumber=bool_2, SecondNumber=rules_0_1_24)  # -> Equality, Inequality
ma_25 = MassAddition(Input=equals_47.Equality)  # -> Result, PartialResults
equals_48 = Equality(FirstNumber=ma_25.Result, SecondNumber="8")  # -> Equality, Inequality
p_n_c_24 = PickNChoose(Pattern=equals_48.Equality, Stream1=origin_pt_tile_geo_24)  # -> flatten(Result)
clean_24 = CleanTree(RemoveNulls=True, RemoveInvalid=True, RemoveEmpty=False, Tree=p_n_c_24)

cage_crv_25 = Curve([<curve referenced from the Rhino model> x6])
guiding_pts_25 = Point([<point referenced from the Rhino model> x2])
element_geo_25 = Geometry([<brep referenced from the Rhino model> x3])
explode_25 = Explode(Curve=cage_crv_25, Recursive=True)  # -> flatten(Segments), Vertices
tile_var_24 = Cluster2(crv=explode_25.Segments, pt=guiding_pts_25, O=element_geo_25)  # -> smaller_than, O_2, O_3, G
origin_pt_tile_geo_25 = Geometry(tile_var_24.G)
guide_pts_25 = Point(tile_var_24.O_3)
rules_0_1_25 = Boolean(tile_var_24.smaller_than)
bbox_crvs_25 = Curve(tile_var_24.O_2)
equals_49 = Equality(FirstNumber=bool_2, SecondNumber=rules_0_1_25)  # -> Equality, Inequality
ma_26 = MassAddition(Input=equals_49.Equality)  # -> Result, PartialResults
equals_50 = Equality(FirstNumber=ma_26.Result, SecondNumber="8")  # -> Equality, Inequality
p_n_c_25 = PickNChoose(Pattern=equals_50.Equality, Stream1=origin_pt_tile_geo_25)  # -> flatten(Result)
clean_25 = CleanTree(RemoveNulls=True, RemoveInvalid=True, RemoveEmpty=False, Tree=p_n_c_25)

cage_crv_26 = Curve([<curve referenced from the Rhino model> x6])
guiding_pts_26 = Point([<point referenced from the Rhino model> x4])
element_geo_26 = Geometry([<brep referenced from the Rhino model> x2])
explode_26 = Explode(Curve=cage_crv_26, Recursive=True)  # -> flatten(Segments), Vertices
tile_var_25 = Cluster22(crv=explode_26.Segments, pt=guiding_pts_26, G=element_geo_26)  # -> crv_3, smaller_than, O, G_2
origin_pt_tile_geo_26 = Geometry(tile_var_25.G_2)
guide_pts_26 = Point(tile_var_25.O)
rules_0_1_26 = Boolean(tile_var_25.smaller_than)
bbox_crvs_26 = Curve(tile_var_25.crv_3)
equals_51 = Equality(FirstNumber=bool_2, SecondNumber=rules_0_1_26)  # -> Equality, Inequality
ma_27 = MassAddition(Input=equals_51.Equality)  # -> Result, PartialResults
equals_52 = Equality(FirstNumber=ma_27.Result, SecondNumber="8")  # -> Equality, Inequality
p_n_c_26 = PickNChoose(Pattern=equals_52.Equality, Stream1=origin_pt_tile_geo_26)  # -> flatten(Result)
clean_26 = CleanTree(RemoveNulls=True, RemoveInvalid=True, RemoveEmpty=False, Tree=p_n_c_26)

cage_crv_27 = Curve([<curve referenced from the Rhino model> x6])
guiding_pts_27 = Point(<point referenced from the Rhino model>)
element_geo_27 = Geometry([<brep referenced from the Rhino model> x4])

cage_crv_28 = Curve([<curve referenced from the Rhino model> x6])
guiding_pts_28 = Point([<point referenced from the Rhino model> x6])
# Window..
element_geo_28 = Geometry([<brep referenced from the Rhino model> x2])
explode_27 = Explode(Curve=cage_crv_28, Recursive=True)  # -> flatten(Segments), Vertices
tile_var_26 = Cluster2(crv=explode_27.Segments, pt=guiding_pts_28, O=element_geo_28)  # -> smaller_than, O_2, O_3, G
rules_0_1_27 = Boolean(tile_var_26.smaller_than)
bbox_crvs_27 = Curve(tile_var_26.O_2)
guide_pts_27 = Point(tile_var_26.O_3)
origin_pt_tile_geo_27 = Geometry(tile_var_26.G)
equals_53 = Equality(FirstNumber=bool_2, SecondNumber=rules_0_1_27)  # -> Equality, Inequality
ma_28 = MassAddition(Input=equals_53.Equality)  # -> Result, PartialResults
equals_54 = Equality(FirstNumber=ma_28.Result, SecondNumber="8")  # -> Equality, Inequality
p_n_c_27 = PickNChoose(Pattern=equals_54.Equality, Stream1=origin_pt_tile_geo_27)  # -> flatten(Result)
clean_27 = CleanTree(RemoveNulls=True, RemoveInvalid=True, RemoveEmpty=False, Tree=p_n_c_27)

element_geo_29 = Geometry([<brep referenced from the Rhino model> x2])
guiding_pts_29 = Point([<point referenced from the Rhino model> x2])
# Middle wall
cage_crv_29 = Curve([<curve referenced from the Rhino model> x6])
explode_28 = Explode(Curve=cage_crv_29, Recursive=True)  # -> flatten(Segments), Vertices
tile_var_27 = Cluster2(crv=explode_28.Segments, pt=guiding_pts_29, O=element_geo_29)  # -> smaller_than, O_2, O_3, G
rules_0_1_28 = Boolean(tile_var_27.smaller_than)
bbox_crvs_28 = Curve(tile_var_27.O_2)
guide_pts_28 = Point(tile_var_27.O_3)
origin_pt_tile_geo_28 = Geometry(tile_var_27.G)
equals_55 = Equality(FirstNumber=bool_2, SecondNumber=rules_0_1_28)  # -> Equality, Inequality
ma_29 = MassAddition(Input=equals_55.Equality)  # -> Result, PartialResults
equals_56 = Equality(FirstNumber=ma_29.Result, SecondNumber="8")  # -> Equality, Inequality
p_n_c_28 = PickNChoose(Pattern=equals_56.Equality, Stream1=origin_pt_tile_geo_28)  # -> flatten(Result)
clean_28 = CleanTree(RemoveNulls=True, RemoveInvalid=True, RemoveEmpty=False, Tree=p_n_c_28)

cage_crv_30 = Curve([<curve referenced from the Rhino model> x6])
guiding_pts_30 = Point([<point referenced from the Rhino model> x4])
element_geo_30 = Geometry([<brep referenced from the Rhino model> x2])
explode_29 = Explode(Curve=cage_crv_30, Recursive=True)  # -> flatten(Segments), Vertices
tile_var_28 = Cluster2_3(crv=explode_29.Segments, pt=guiding_pts_30, O=element_geo_30)  # -> R_2, R, smaller_than, O_2, O_3, G
rules_0_1_29 = Boolean(tile_var_28.smaller_than)
bbox_crvs_29 = Curve(tile_var_28.O_2)
guide_pts_29 = Point(tile_var_28.O_3)
origin_pt_tile_geo_29 = Geometry(tile_var_28.G)
equals_57 = Equality(FirstNumber=bool_2, SecondNumber=rules_0_1_29)  # -> Equality, Inequality
ma_30 = MassAddition(Input=equals_57.Equality)  # -> Result, PartialResults
equals_58 = Equality(FirstNumber=ma_30.Result, SecondNumber="8")  # -> Equality, Inequality
p_n_c_29 = PickNChoose(Pattern=equals_58.Equality, Stream1=origin_pt_tile_geo_29)  # -> flatten(Result)
clean_29 = CleanTree(RemoveNulls=True, RemoveInvalid=True, RemoveEmpty=False, Tree=p_n_c_29)

cage_crv_31 = Curve([<curve referenced from the Rhino model> x6])
guiding_pts_31 = Point([<point referenced from the Rhino model> x2])
element_geo_31 = Geometry(<brep referenced from the Rhino model>)
explode_30 = Explode(Curve=cage_crv_27, Recursive=True)  # -> flatten(Segments), Vertices
guiding_pts_32 = Point([<point referenced from the Rhino model> x2])
cage_crv_32 = Curve([<curve referenced from the Rhino model> x6])
element_geo_32 = Geometry([<brep referenced from the Rhino model> x3])
explode_31 = Explode(Curve=cage_crv_31, Recursive=True)  # -> flatten(Segments), Vertices
explode_32 = Explode(Curve=cage_crv_32, Recursive=True)  # -> flatten(Segments), Vertices
tile_var_29 = Cluster2_5(crv=explode_30.Segments, pt=guiding_pts_27, O=element_geo_27)  # -> smaller_than, O_3, O_2, G
tile_var_30 = Cluster2_4(crv=explode_30.Segments, pt=guiding_pts_27, O=element_geo_27)  # -> smaller_than, O_2, O_3, G
tile_var_31 = Cluster2(crv=explode_31.Segments, pt=guiding_pts_31, O=element_geo_31)  # -> smaller_than, O_2, O_3, G
tile_var_32 = Cluster2(crv=explode_32.Segments, pt=guiding_pts_32, O=element_geo_32)  # -> smaller_than, O_2, O_3, G
rules_0_1_30 = Boolean(tile_var_30.smaller_than)
bbox_crvs_30 = Curve(tile_var_30.O_2)
guide_pts_30 = Point(tile_var_30.O_3)
origin_pt_tile_geo_30 = Geometry(tile_var_30.G)
rules_0_1_31 = Boolean(tile_var_29.smaller_than)
guide_pts_31 = Point(tile_var_29.O_3)
origin_pt_tile_geo_31 = Geometry(tile_var_29.G)
bbox_crvs_31 = Curve(tile_var_29.O_2)
rules_0_1_32 = Boolean(tile_var_31.smaller_than)
bbox_crvs_32 = Curve(tile_var_31.O_2)
guide_pts_32 = Point(tile_var_31.O_3)
origin_pt_tile_geo_32 = Geometry(tile_var_31.G)
equals_59 = Equality(FirstNumber=bool, SecondNumber=rules_0_1_31)  # -> Equality, Inequality
python = GhPythonScript(x=equals_57.Equality, y=equals_59.Equality)  # -> out, a; inputs x: tree of Int32, y: tree of Int32
# ---------- python: Python ----------
import rhinoscriptsyntax as rs
import ghpythonlib.treehelpers as th

xt = th.tree_to_list(x,0)
yt = th.tree_to_list(y,0)

def intersection(lst1, lst2): 
    lst3 = [value for value in lst1 if value in lst2] 
    return lst3

commonlist = intersection(xt,yt)

breaklist = sum(commonlist,[])

a = yt.index(breaklist) 
b = xt.index(breaklist) 

def func():
    if a == b:
       return a 
    else:
        return 0

print func()
# ---------- end python ----------
equals_60 = Equality(FirstNumber=bool, SecondNumber=rules_0_1_31)  # -> Equality, Inequality
python_2 = GhPythonScript(x=equals_57.Equality, y=equals_60.Equality)  # -> out, a; inputs x: tree of Int32, y: tree of Int32; same code as python
rules_0_1_33 = Boolean(tile_var_32.smaller_than)
bbox_crvs_33 = Curve(tile_var_32.O_2)
guide_pts_33 = Point(tile_var_32.O_3)
origin_pt_tile_geo_33 = Geometry(tile_var_32.G)
equals_61 = Equality(FirstNumber=bool, SecondNumber=rules_0_1_32)  # -> Equality, Inequality
num = Number(equals_57.Equality)
panel = Panel("""0
0
0
0""")
panel_2 = Panel("""0
0
0
0""")
equals_62 = Equality(FirstNumber=bool, SecondNumber=rules_0_1_33)  # -> Equality, Inequality
python_3 = GhPythonScript(x=equals_15.Equality, y=equals_62.Equality)  # -> out, a; inputs x: tree of Int32, y: tree of Int32
# ---------- python_3: Python ----------
import rhinoscriptsyntax as rs
import ghpythonlib.treehelpers as th

xt = th.tree_to_list(x,0)

print(xt)
# ---------- end python_3 ----------
num_2 = Number(equals_57.Equality)
ma_31 = MassAddition(Input=equals_61.Equality)  # -> Result, PartialResults
ma_32 = MassAddition(Input=num)  # -> flatten(Result), PartialResults
replace = ReplaceItems(List=panel, Item="1", Indices=python_2.a, Wrap=False)  # -> simplify(graft(List))
replace_2 = ReplaceItems(List=panel_2, Item="1", Indices=python.a, Wrap=False)  # -> simplify(graft(List))
python_4 = GhPythonScript(x=num_2, y=equals_62.Equality)  # -> out, a; inputs x: tree of Int32, y: tree of Int32; same code as python
addition = Addition(A=ma_32.Result, B=ma_31.Result)  # -> graft(Result)
panel_3 = Panel("""0
0
0
0""")
p_n_c_30 = PickNChoose(Pattern=graft(replace_2), Stream1=origin_pt_tile_geo_31)  # -> flatten(Result)
p_n_c_31 = PickNChoose(Pattern=graft(replace), Stream1=origin_pt_tile_geo_31)  # -> flatten(Result)
replace_3 = ReplaceItems(List=panel_3, Item="1", Indices=python_4.a, Wrap=False)  # -> simplify(graft(List))
lng_2 = ListLength(List=ma_32.Result)
ma_33 = MassAddition(Input=addition)  # -> Result, PartialResults
clean_30 = CleanTree(RemoveNulls=p_n_c_30, RemoveInvalid=True, RemoveEmpty=False)
clean_31 = CleanTree(RemoveNulls=p_n_c_31, RemoveInvalid=True, RemoveEmpty=False)
equals_63 = Equality(FirstNumber=ma_33.Result, SecondNumber="16")  # -> Equality, Inequality
p_n_c_32 = PickNChoose(Pattern=graft(replace_3), Stream1=origin_pt_tile_geo_33)  # -> flatten(Result)
p_n_c_33 = PickNChoose(Pattern=graft([0, 1]), Stream1=origin_pt_tile_geo_30)  # -> flatten(Result)
partition = PartitionList(List=flatten(equals_63.Equality), Size=lng_2)  # -> simplify(Chunks)
clean_32 = CleanTree(RemoveNulls=True, RemoveInvalid=True, RemoveEmpty=False, Tree=p_n_c_32)
ma_34 = MassAddition(Input=partition)  # -> Result, PartialResults
p_n_c_34 = PickNChoose(Pattern=graft(ma_34.Result), Stream1=origin_pt_tile_geo_32)  # -> flatten(Result)
clean_33 = CleanTree(RemoveNulls=True, RemoveInvalid=True, RemoveEmpty=False, Tree=p_n_c_33)
clean_34 = CleanTree(RemoveNulls=True, RemoveInvalid=True, RemoveEmpty=False, Tree=p_n_c_34)
ma_35 = MassAddition(Input=mindex_2.Count)  # -> Result, PartialResults
larger_2 = LargerThan(FirstNumber=ma_35.Result, SecondNumber=Slider(1, range=0..1))  # -> LargerThan, flatten(OrEqualTo)
ma_36 = MassAddition(Input=mindex_3.Count)  # -> Result, PartialResults
merge_4 = Merge(Data1=clean_28, Data2=clean_29, Data3=clean_27)
merge_5 = Merge(Data1=clean_33, Data3=clean_31, Data5=clean_32, Data6=clean_34)
larger_3 = LargerThan(FirstNumber=ma_36.Result, SecondNumber=Slider(1, range=0..1))  # -> LargerThan, flatten(OrEqualTo)
python_5 = GhPythonScript(BottomFrame=larger.OrEqualTo, TopFrame=larger_2.OrEqualTo, MiddleFrame=larger_3.OrEqualTo)  # -> out, a
# ---------- python_5: Python ----------
__author__ = "sk928"
__version__ = "2022.03.21"

import rhinoscriptsyntax as rs
if BottomFrame == False:
    a = 0

if BottomFrame == True:
    a = 1 

if TopFrame == True:
    a = 2

if MiddleFrame == True:
    a =3
# ---------- end python_5 ----------

# ----
# Top wall with edge
cage_crv_33 = Curve([<curve referenced from the Rhino model> x6])
guiding_pts_33 = Point([<point referenced from the Rhino model> x2])
element_geo_33 = Geometry([<brep referenced from the Rhino model> x3])
explode_33 = Explode(Curve=cage_crv_33, Recursive=True)  # -> flatten(Segments), Vertices
tile_var_33 = Cluster2(crv=explode_33.Segments, pt=guiding_pts_33, O=element_geo_33)  # -> smaller_than, O_2, O_3, G
origin_pt_tile_geo_34 = Geometry(tile_var_33.G)
guide_pts_34 = Point(tile_var_33.O_3)
rules_0_1_34 = Boolean(tile_var_33.smaller_than)
bbox_crvs_34 = Curve(tile_var_33.O_2)
equals_64 = Equality(FirstNumber=bool_2, SecondNumber=rules_0_1_34)  # -> Equality, Inequality
ma_37 = MassAddition(Input=equals_64.Equality)  # -> Result, PartialResults
equals_65 = Equality(FirstNumber=ma_37.Result, SecondNumber="8")  # -> Equality, Inequality
p_n_c_35 = PickNChoose(Pattern=equals_65.Equality, Stream1=origin_pt_tile_geo_34)  # -> flatten(Result)
clean_35 = CleanTree(RemoveNulls=True, RemoveInvalid=True, RemoveEmpty=False, Tree=p_n_c_35)

cage_crv_34 = Curve([<curve referenced from the Rhino model> x6])
guiding_pts_34 = Point([<point referenced from the Rhino model> x6])
element_geo_34 = Geometry([<brep referenced from the Rhino model> x3])
explode_34 = Explode(Curve=cage_crv_34, Recursive=True)  # -> flatten(Segments), Vertices
tile_var_34 = Cluster2(crv=explode_34.Segments, pt=guiding_pts_34, O=element_geo_34)  # -> smaller_than, O_2, O_3, G
origin_pt_tile_geo_35 = Geometry(tile_var_34.G)
guide_pts_35 = Point(tile_var_34.O_3)
rules_0_1_35 = Boolean(tile_var_34.smaller_than)
bbox_crvs_35 = Curve(tile_var_34.O_2)
equals_66 = Equality(FirstNumber=bool_2, SecondNumber=rules_0_1_35)  # -> Equality, Inequality
ma_38 = MassAddition(Input=equals_66.Equality)  # -> Result, PartialResults
equals_67 = Equality(FirstNumber=ma_38.Result, SecondNumber="8")  # -> Equality, Inequality
p_n_c_36 = PickNChoose(Pattern=equals_67.Equality, Stream1=origin_pt_tile_geo_35)  # -> flatten(Result)
clean_36 = CleanTree(RemoveNulls=True, RemoveInvalid=True, RemoveEmpty=False, Tree=p_n_c_36)

cage_crv_35 = Curve([<curve referenced from the Rhino model> x6])
guiding_pts_35 = Point([<point referenced from the Rhino model> x4])
element_geo_35 = Geometry([<brep referenced from the Rhino model> x3])
explode_35 = Explode(Curve=cage_crv_35, Recursive=True)  # -> flatten(Segments), Vertices
tile_var_35 = Cluster2(crv=explode_35.Segments, pt=guiding_pts_35, O=element_geo_35)  # -> smaller_than, O_2, O_3, G
origin_pt_tile_geo_36 = Geometry(tile_var_35.G)
guide_pts_36 = Point(tile_var_35.O_3)
rules_0_1_36 = Boolean(tile_var_35.smaller_than)
bbox_crvs_36 = Curve(tile_var_35.O_2)
equals_68 = Equality(FirstNumber=bool_2, SecondNumber=rules_0_1_36)  # -> Equality, Inequality
ma_39 = MassAddition(Input=equals_68.Equality)  # -> Result, PartialResults
equals_69 = Equality(FirstNumber=ma_39.Result, SecondNumber="8")  # -> Equality, Inequality
p_n_c_37 = PickNChoose(Pattern=equals_69.Equality, Stream1=origin_pt_tile_geo_36)  # -> flatten(Result)
clean_37 = CleanTree(RemoveNulls=True, RemoveInvalid=True, RemoveEmpty=False, Tree=p_n_c_37)

# ---- group: Ground level
pdecon = Deconstruct(Point=box.Point)  # -> XComponent, YComponent, ZComponent
smaller_5 = SmallerThan(FirstNumber=pdecon.ZComponent, SecondNumber="50")  # -> SmallerThan, flatten(OrEqualTo)

# ----
ma_40 = MassAddition(Input=smaller_5.OrEqualTo)  # -> Result, PartialResults
merge_6 = Merge(Data1=clean, Data2=clean_5, Data3=clean_3, Data4=clean_7)
merge_7 = Merge(Data1=clean_23, Data2=clean_25, Data3=clean_24, Data4=clean_26)
larger_4 = LargerThan(FirstNumber=ma_40.Result, SecondNumber=Slider(1, range=0..1))  # -> LargerThan, OrEqualTo
filter = StreamFilter(Gate=larger_4.OrEqualTo, Stream0=merge_6, Stream1=merge_7)
panel_4 = Panel(clean_26)
merge_8 = Merge(Data1=clean_35, Data2=clean_37, Data3=clean_36)
filter_2 = StreamFilter(Gate=python_5.a, Stream0=merge_4, Stream1=merge_3, Stream2=merge_8, Stream3=merge_5)
merge_9 = Merge(
    Data1=clean_8,
    Data2=clean_10,
    Data3=clean_9,
    Data4=filter_2,
    Data7=clean_11,
    Data8=clean_2,
    Data9=clean_6,
    Data10=clean_4,
    Data11=filter,
    Data12=clean_14,
    Data13=clean_15,
    Data14=clean_17,
    Data15=clean_12,
    Data16=clean_13,
    Data17=clean_18,
    Data18=clean_16,
    Data19=clean_19)
item_3 = ListItem(List=merge_9, Index=0, Wrap=True)
ungroup_2 = Ungroup(Group=item_3)
split = SplitList(List=ungroup_2, Index="1")  # -> ListA, ListB
item_4 = ListItem(List=merge, Index=0, Wrap=True)
pt_4 = Point(split.ListA)
vec2pt = Vector2Pt(PointA=pt_4, PointB=item_4, Unitize=False)  # -> Vector, Length
move = Move(Geometry=split.ListB, Motion=vec2pt.Vector)  # -> Geometry, Transform
merge_10 = Merge(Data1=loop_start.Data, Data2=move.Geometry)  # -> flatten(Result)
running = Running(port=loop_start.port, Exit=False, Data=merge_10, TimeOutVal=0, pausedState=False, state="Constant output")
brep_4 = Brep(merge_10)
preview_2 = CustomPreview(Geometry=brep_4, Material=ColourSwatch(SwatchColor=RGB(218, 193, 168)))

# ==== cluster Cluster2
pt = ClusterInput()
crv = ClusterInput()
O = ClusterInput()
crv_2 = Curve(crv)
pt_2 = Point(pt)
bbox = BoundingBox(Content=crv_2, Plane=PlaneXY(0, 0, 0), UnionBox=True)  # -> Box, Box_2

group = Group(Objects=O)
group_2 = Group(Objects=pt_2)
merge = Merge(Data1=group_2, Data2=group)
group_3 = Group(Objects=merge)

pt_3 = Point(pt_2)
box = EvaluateBox(Box=bbox.Box, UParameter=0.5, VParameter=0.5, WParameter=0.5)  # -> Plane, Point, Include
group_4 = Group(Objects=pt_3)
xy = XYPlane(Origin=box.Point)
panel = Panel("""0
90
180
270""")

# ---- group: Getting box array
box_2 = Box(bbox.Box)
box_3 = EvaluateBox(Box=box_2, UParameter="0", VParameter="0", WParameter="1")  # -> Plane, Point, Include
box_4 = EvaluateBox(Box=box_2, UParameter="0", VParameter="0", WParameter="0")  # -> Plane, Point, Include
dist = Distance(PointA=box_4.Point, PointB=box_3.Point)
multiplication = Multiplication(A=dist, B="1.5")

# ----
rotate = Rotate(Geometry=group_4, Angle=degrees(panel), Plane=xy)  # -> simplify(graft(Geometry)), simplify(graft(Transform))
ungroup = Ungroup(Group=rotate.Geometry)
transform1 = Transform(rotate.Transform)
pt2num = PointsToNumbers(Points=ungroup, Mask=4)
join = TextJoin(Text=pt2num)  # -> flatten(Result)
cset = CreateSet(List=join)  # -> Set, Map
brep = Brep(O)
fsim = FindSimilarMember(Data=cset.Set, Set=join)  # -> Hit, Index
item = ListItem(List=flatten(transform1), Index=fsim.Index, Wrap=True)

# ---- group: All in one box
transform = Transform(Geometry=group_3, Transform=item)

# ----
lng = ListLength(List=transform)
num = Number(multiplication)
series = Series(Start=0, Step=num, Count=lng)
group_5 = Group(Objects=crv_2)
Z = UnitZ(Factor=series)
move = Move(Geometry=group_5, Motion=Z)  # -> Geometry, Transform
move_2 = Move(Geometry=transform, Motion=Z)  # -> Geometry, Transform
ungroup_2 = Ungroup(Group=move_2.Geometry)
ungroup_3 = Ungroup(Group=move.Geometry)
item_2 = ListItem(List=ungroup_2, Index=0, Wrap=True)  # -> Item, Item1
bbox_2 = BoundingBox(Content=ungroup_3, Plane=PlaneXY(0, 0, 0), UnionBox=True)  # -> Box, Box_2
ungroup_4 = Ungroup(Group=item_2.Item1)  # -> simplify(Objects)
ungroup_5 = Ungroup(Group=item_2.Item)  # -> simplify(Objects)
box_corners = BoxCorners(Box=bbox_2.Box)  # -> CornerA, CornerB, CornerC, CornerD, CornerE, CornerF, CornerG, CornerH
box_5 = EvaluateBox(Box=bbox_2.Box, UParameter="0", VParameter="0", WParameter="0")  # -> Plane, Point, Include
merge_2 = Merge(
    Data1=box_corners.CornerA,
    Data2=box_corners.CornerB,
    Data3=box_corners.CornerC,
    Data4=box_corners.CornerD,
    Data5=box_corners.CornerE,
    Data6=box_corners.CornerF,
    Data7=box_corners.CornerG,
    Data8=box_corners.CornerH)  # -> simplify(Result)
pt_4 = Point(simplify(box_5.Point))
cp = ClosestPoint(Point=merge_2, Cloud=ungroup_5)  # -> ClosestPoint, CPIndex, Distance
merge_3 = Merge(Data1=pt_4, Data2=ungroup_4)
panel_2 = Panel(ungroup_2)
smaller = SmallerThan(FirstNumber=cp.Distance, SecondNumber="0.01")  # -> SmallerThan, OrEqualTo
panel_3 = Panel(smaller.SmallerThan)
group_6 = Group(Objects=merge_3)
smaller_than = ClusterOutput(smaller.SmallerThan)
O_2 = ClusterOutput(ungroup_3)
O_3 = ClusterOutput(ungroup_5)
G = ClusterOutput(group_6)

# ==== cluster Cluster22
pt = ClusterInput()
crv = ClusterInput()
G = ClusterInput()
crv_2 = Curve(crv)
pt_2 = Point(pt)
bbox = BoundingBox(Content=crv_2, Plane=PlaneXY(0, 0, 0), UnionBox=True)  # -> Box, Box_2
ungroup = Ungroup(Group=pt_2)  # -> simplify(flatten(Objects))
crv_3 = ClusterOutput(crv_2)
O = ClusterOutput(ungroup)
box = EvaluateBox(Box=bbox.Box, UParameter="0", VParameter="0", WParameter="0")  # -> Plane, Point, Include
box_corners = BoxCorners(Box=bbox.Box)  # -> CornerA, CornerB, CornerC, CornerD, CornerE, CornerF, CornerG, CornerH
ungroup_2 = Ungroup(Group=G)  # -> simplify(Objects)
pt_3 = Point(simplify(box.Point))
merge = Merge(
    Data1=box_corners.CornerA,
    Data2=box_corners.CornerB,
    Data3=box_corners.CornerC,
    Data4=box_corners.CornerD,
    Data5=box_corners.CornerE,
    Data6=box_corners.CornerF,
    Data7=box_corners.CornerG,
    Data8=box_corners.CornerH)  # -> simplify(Result)
merge_2 = Merge(Data1=pt_3, Data2=ungroup_2)  # -> flatten(Result)
cp = ClosestPoint(Point=merge, Cloud=ungroup)  # -> ClosestPoint, CPIndex, Distance
group = Group(Objects=merge_2)
panel = Panel(merge_2)
smaller = SmallerThan(FirstNumber=cp.Distance, SecondNumber="0.01")  # -> SmallerThan, OrEqualTo
G_2 = ClusterOutput(group)
smaller_than = ClusterOutput(smaller.SmallerThan)

# ==== cluster Cluster2_2
pt = ClusterInput()
crv = ClusterInput()
O = ClusterInput()
crv_2 = Curve(crv)
pt_2 = Point(pt)
bbox = BoundingBox(Content=crv_2, Plane=PlaneXY(0, 0, 0), UnionBox=True)  # -> Box, Box_2
pt_3 = Point(pt_2)

group = Group(Objects=pt_2)
group_2 = Group(Objects=O)
merge = Merge(Data1=group, Data2=group_2)
group_3 = Group(Objects=merge)

box = EvaluateBox(Box=bbox.Box, UParameter=0.5, VParameter=0.5, WParameter=0.5)  # -> Plane, Point, Include
group_4 = Group(Objects=pt_3)
xy = XYPlane(Origin=box.Point)
xz = XZPlane(Origin=box.Point)
yz = YZPlane(Origin=box.Point)
panel = Panel("""0
90
180
270""")

# ---- group: Getting box array
box_2 = Box(bbox.Box)
box_3 = EvaluateBox(Box=box_2, UParameter="0", VParameter="0", WParameter="1")  # -> Plane, Point, Include
box_4 = EvaluateBox(Box=box_2, UParameter="0", VParameter="0", WParameter="0")  # -> Plane, Point, Include
dist = Distance(PointA=box_4.Point, PointB=box_3.Point)
multiplication = Multiplication(A=dist, B="1.5")

# ----
rotate = Rotate(Geometry=group_4, Angle=degrees(panel), Plane=xy)  # -> simplify(graft(Geometry)), simplify(graft(Transform))
mirror = Mirror(Geometry=rotate.Geometry, Plane=yz)  # -> Geometry, Transform
merge_2 = Merge(Data1=flatten(rotate.Geometry), Data2=flatten(mirror.Geometry))
merge_3 = Merge(Data1=rotate.Transform, Data2=mirror.Transform)
item = ListItem(List=merge_2, Index=Slider(0, range=0..10), Wrap=True)
ungroup = Ungroup(Group=merge_2)
comp = Compound(Transforms=merge_3)
repeat = RepeatData(Data=comp, Length="4")  # -> graft(Data)
pt2num = PointsToNumbers(Points=ungroup, Mask=4)
flatten = FlattenTree(Tree=comp, Path="{0}")
flatten_2 = FlattenTree(Tree=rotate.Transform, Path="{0}")
join = TextJoin(Text=pt2num)  # -> flatten(Result)
merge_4 = Merge(Data1=flatten, Data2=flatten_2)
panel_2 = Panel(merge_4)
cset = CreateSet(List=join)  # -> Set, Map
transform1 = Transform(merge_4)
fsim = FindSimilarMember(Data=join, Set=join)  # -> Hit, Index
item_2 = ListItem(List=flatten(transform1), Index=fsim.Index, Wrap=True)

# ---- group: All in one box
transform = Transform(Geometry=group_3, Transform=item_2)

# ----
lng = ListLength(List=transform)
num = Number(multiplication)
series = Series(Start=0, Step=num, Count=lng)
group_5 = Group(Objects=crv_2)
Z = UnitZ(Factor=series)
move = Move(Geometry=group_5, Motion=Z)  # -> Geometry, Transform
move_2 = Move(Geometry=transform, Motion=Z)  # -> Geometry, Transform
ungroup_2 = Ungroup(Group=move_2.Geometry)
ungroup_3 = Ungroup(Group=move.Geometry)
item_3 = ListItem(List=ungroup_2, Index=0, Wrap=True)  # -> Item, Item1
bbox_2 = BoundingBox(Content=ungroup_3, Plane=PlaneXY(0, 0, 0), UnionBox=True)  # -> Box, Box_2
ungroup_4 = Ungroup(Group=item_3.Item1)  # -> simplify(Objects)
ungroup_5 = Ungroup(Group=item_3.Item)  # -> simplify(Objects)
box_corners = BoxCorners(Box=bbox_2.Box)  # -> CornerA, CornerB, CornerC, CornerD, CornerE, CornerF, CornerG, CornerH
box_5 = EvaluateBox(Box=bbox_2.Box, UParameter="0", VParameter="0", WParameter="0")  # -> Plane, Point, Include
merge_5 = Merge(
    Data1=box_corners.CornerA,
    Data2=box_corners.CornerB,
    Data3=box_corners.CornerC,
    Data4=box_corners.CornerD,
    Data5=box_corners.CornerE,
    Data6=box_corners.CornerF,
    Data7=box_corners.CornerG,
    Data8=box_corners.CornerH)  # -> simplify(Result)
pt_4 = Point(simplify(box_5.Point))
merge_6 = Merge(Data1=pt_4, Data2=ungroup_4)
cp = ClosestPoint(Point=merge_5, Cloud=ungroup_5)  # -> ClosestPoint, CPIndex, Distance
group_6 = Group(Objects=merge_6)
smaller = SmallerThan(FirstNumber=cp.Distance, SecondNumber="0.01")  # -> SmallerThan, OrEqualTo
panel_3 = Panel(smaller.SmallerThan)
panel_4 = Panel(merge_6)
smaller_than = ClusterOutput(smaller.SmallerThan)
O_2 = ClusterOutput(ungroup_3)
O_3 = ClusterOutput(ungroup_5)
G = ClusterOutput(group_6)

# ==== cluster Cluster2_3
pt = ClusterInput()
crv = ClusterInput()
O = ClusterInput()
crv_2 = Curve(crv)
pt_2 = Point(pt)
bbox = BoundingBox(Content=crv_2, Plane=PlaneXY(0, 0, 0), UnionBox=True)  # -> Box, Box_2

group = Group(Objects=O)
group_2 = Group(Objects=pt_2)
merge = Merge(Data1=group_2, Data2=group)
group_3 = Group(Objects=merge)

pt_3 = Point(pt_2)
box = EvaluateBox(Box=bbox.Box, UParameter=0.5, VParameter=0.5, WParameter=0.5)  # -> Plane, Point, Include
group_4 = Group(Objects=pt_3)
xy = XYPlane(Origin=box.Point)
panel = Panel("""0
90
180
270""")

# ---- group: Getting box array
box_2 = Box(bbox.Box)
box_3 = EvaluateBox(Box=box_2, UParameter="0", VParameter="0", WParameter="1")  # -> Plane, Point, Include
box_4 = EvaluateBox(Box=box_2, UParameter="0", VParameter="0", WParameter="0")  # -> Plane, Point, Include
dist = Distance(PointA=box_4.Point, PointB=box_3.Point)
multiplication = Multiplication(A=dist, B="1.5")

# ----
rotate = Rotate(Geometry=group_4, Angle=degrees(panel), Plane=xy)  # -> simplify(graft(Geometry)), simplify(graft(Transform))
ungroup = Ungroup(Group=rotate.Geometry)
transform1 = Transform(rotate.Transform)
pt2num = PointsToNumbers(Points=ungroup, Mask=4)
join = TextJoin(Text=pt2num)  # -> flatten(Result)
cset = CreateSet(List=join)  # -> Set, Map
fsim = FindSimilarMember(Data=cset.Set, Set=join)  # -> Hit, Index
item = ListItem(List=flatten(transform1), Index=fsim.Index, Wrap=True)

# ---- group: All in one box
transform = Transform(Geometry=group_3, Transform=item)

# ----
lng = ListLength(List=transform)
num = Number(multiplication)
series = Series(Start=0, Step=num, Count=lng)
group_5 = Group(Objects=crv_2)
Z = UnitZ(Factor=series)
move = Move(Geometry=group_5, Motion=Z)  # -> Geometry, Transform
move_2 = Move(Geometry=transform, Motion=Z)  # -> Geometry, Transform
ungroup_2 = Ungroup(Group=move_2.Geometry)
ungroup_3 = Ungroup(Group=move.Geometry)
item_2 = ListItem(List=ungroup_2, Index=0, Wrap=True)  # -> Item, Item1
bbox_2 = BoundingBox(Content=ungroup_3, Plane=PlaneXY(0, 0, 0), UnionBox=True)  # -> Box, Box_2
ungroup_4 = Ungroup(Group=item_2.Item1)  # -> simplify(Objects)
ungroup_5 = Ungroup(Group=item_2.Item)  # -> simplify(Objects)
box_corners = BoxCorners(Box=bbox_2.Box)  # -> CornerA, CornerB, CornerC, CornerD, CornerE, CornerF, CornerG, CornerH
box_5 = EvaluateBox(Box=bbox_2.Box, UParameter="0", VParameter="0", WParameter="0")  # -> Plane, Point, Include
merge_2 = Merge(
    Data1=box_corners.CornerA,
    Data2=box_corners.CornerB,
    Data3=box_corners.CornerC,
    Data4=box_corners.CornerD,
    Data5=box_corners.CornerE,
    Data6=box_corners.CornerF,
    Data7=box_corners.CornerG,
    Data8=box_corners.CornerH)  # -> simplify(Result)
pt_4 = Point(simplify(box_5.Point))
tstat = TreeStatistics(Tree=merge_2)  # -> Paths, Length, Count
cp = ClosestPoint(Point=merge_2, Cloud=ungroup_5)  # -> ClosestPoint, CPIndex, Distance
merge_3 = Merge(Data1=pt_4, Data2=ungroup_4)
smaller = SmallerThan(FirstNumber=cp.Distance, SecondNumber="0.01")  # -> SmallerThan, OrEqualTo
smaller_2 = SmallerThan(FirstNumber=cp.Distance, SecondNumber="0.01")  # -> SmallerThan, OrEqualTo
group_6 = Group(Objects=merge_3)
panel_2 = Panel("""0
2""")
panel_3 = Panel("""1
3""")
item_3 = ListItem(List=tstat.Paths, Index=panel_2, Wrap=True)
item_4 = ListItem(List=tstat.Paths, Index=panel_3, Wrap=True)
split = SplitTree(Data=smaller_2.SmallerThan, Masks=flatten(item_3))  # -> Positive, Negative
panel_4 = Panel("""0
1
2
3
4
5
6
7""")
split_2 = SplitTree(Data=smaller_2.SmallerThan, Masks=flatten(item_4))  # -> Positive, Negative
panel_5 = Panel("""0
1
2
3
4
5
6
7""")
replace = ReplaceItems(List=split_2.Positive, Item="False", Indices=panel_4, Wrap=False)  # -> simplify(List)
replace_2 = ReplaceItems(List=split.Positive, Item="False", Indices=panel_5, Wrap=False)  # -> simplify(List)
merge_4 = Merge(Data1=replace_2, Data2=split.Negative)
merge_5 = Merge(Data1=replace, Data2=split_2.Negative)
R = ClusterOutput(merge_5)
smaller_than = ClusterOutput(smaller.SmallerThan)
O_2 = ClusterOutput(ungroup_3)
O_3 = ClusterOutput(ungroup_5)
G = ClusterOutput(group_6)
R_2 = ClusterOutput(merge_4)
panel_6 = Panel(merge_4)

# ==== cluster Cluster
number_slider = Slider(54, range=0..100)
C = ClusterInput()
number_slider_2 = Slider(90, range=0..100)
bbox = BoundingBox(Content=C, Plane=PlaneXY(0, 0, 0), UnionBox=True)  # -> Box, Box_2
debox = DeconstructBox(Box=bbox.Box)  # -> Plane, X, Y, Z
number_slider_3 = ClusterOutput(number_slider)
division = Division(A=number_slider_2, B="2")
division_2 = Division(A=number_slider, B="2")
voxel_size = Number(number_slider_2)
dedomain = DeconstructDomain(Domain=debox.Z)  # -> Start, End
dedomain_2 = DeconstructDomain(Domain=[debox.X, debox.Y])  # -> Start, End
neg = Negative(Value=division_2)
neg_2 = Negative(Value=division)
subtraction = Subtraction(A=dedomain_2.Start, B=number_slider_2)
addition = Addition(A=dedomain_2.End, B=number_slider_2)
subtraction_2 = Subtraction(A=dedomain.Start, B=voxel_size)
addition_2 = Addition(A=dedomain.End, B=voxel_size)
pt = ConstructPoint(XCoordinate=neg_2, YCoordinate=neg_2, ZCoordinate=neg)
subtraction_3 = Subtraction(A=addition, B=subtraction)
subtraction_4 = Subtraction(A=addition_2, B=subtraction_2)
xy = XYPlane(Origin=pt)
division_3 = Division(A=subtraction_4, B=number_slider)
division_4 = Division(A=subtraction_3, B=voxel_size)
box = DomainBox(Base=xy, X=voxel_size, Y=voxel_size, Z=number_slider)
B = ClusterInput()
move2pt = MoveToPoint(Geometry=box, PointA=xy, PointB=B)  # -> Moved, Vector, Transform
item = ListItem(List=[division_4, division_3], Index=0, Wrap=True)  # -> Item, Item1, Item2
move = Move(Geometry=move2pt.Moved, Motion=pt)  # -> Geometry, Transform
arrbox = BoxArray(Geometry=move.Geometry, Cell=box, XCount=item.Item, YCount=item.Item1, ZCount=item.Item2)  # -> Geometry, Transform
multiplication = Multiplication(A=item.Item, B=item.Item1)
G = ClusterOutput(arrbox.Geometry)
partition = PartitionList(List=flatten(arrbox.Geometry), Size=multiplication)
group = Group(Objects=partition)
G_2 = ClusterOutput(group)

# ==== cluster Cluster2_4
pt = ClusterInput()
crv = ClusterInput()
O = ClusterInput()
crv_2 = Curve(crv)
pt_2 = Point(pt)
bbox = BoundingBox(Content=crv_2, Plane=PlaneXY(0, 0, 0), UnionBox=True)  # -> Box, Box_2

group = Group(Objects=O)
group_2 = Group(Objects=pt_2)
merge = Merge(Data1=group_2, Data2=group)
group_3 = Group(Objects=merge)

pt_3 = Point(pt_2)
box = EvaluateBox(Box=bbox.Box, UParameter=0.5, VParameter=0.5, WParameter=0.5)  # -> Plane, Point, Include
yz = YZPlane(Origin=box.Point)
xy = XYPlane(Origin=box.Point)
xz = XZPlane(Origin=box.Point)
group_4 = Group(Objects=merge)
group_5 = Group(Objects=pt_3)

# ---- group: Getting box array
box_2 = Box(bbox.Box)
box_3 = EvaluateBox(Box=box_2, UParameter="0", VParameter="0", WParameter="1")  # -> Plane, Point, Include
box_4 = EvaluateBox(Box=box_2, UParameter="0", VParameter="0", WParameter="0")  # -> Plane, Point, Include
dist = Distance(PointA=box_4.Point, PointB=box_3.Point)
multiplication = Multiplication(A=dist, B="1.5")

# ----
number_slider = Slider(90, range=0..100)
rotate = Rotate(Geometry=group_3, Angle=1.570796327, Plane=xy)  # -> Geometry, Transform
mirror = Mirror(Geometry=rotate.Geometry, Plane=xz)  # -> Geometry, Transform
mirror_2 = Mirror(Geometry=mirror.Geometry, Plane=xy)  # -> Geometry, Transform
mirror_3 = Mirror(Geometry=mirror_2.Geometry, Plane=xz)  # -> Geometry, Transform
merge_2 = Merge(Data1=rotate.Geometry, Data2=mirror.Geometry, Data3=mirror_2.Geometry, Data4=mirror_3.Geometry)  # -> flatten(Result)
lng = ListLength(List=merge_2)
num = Number(multiplication)
series = Series(Start=0, Step=num, Count=lng)
group_6 = Group(Objects=crv_2)
Z = UnitZ(Factor=series)
move = Move(Geometry=group_6, Motion=Z)  # -> Geometry, Transform
move_2 = Move(Geometry=merge_2, Motion=Z)  # -> Geometry, Transform
ungroup = Ungroup(Group=move_2.Geometry)
ungroup_2 = Ungroup(Group=move.Geometry)
item = ListItem(List=ungroup, Index=0, Wrap=True)  # -> Item, Item1
bbox_2 = BoundingBox(Content=ungroup_2, Plane=PlaneXY(0, 0, 0), UnionBox=True)  # -> Box, Box_2
ungroup_3 = Ungroup(Group=item.Item1)  # -> simplify(Objects)
ungroup_4 = Ungroup(Group=item.Item)  # -> simplify(Objects)
box_corners = BoxCorners(Box=bbox_2.Box)  # -> CornerA, CornerB, CornerC, CornerD, CornerE, CornerF, CornerG, CornerH
box_5 = EvaluateBox(Box=bbox_2.Box, UParameter="0", VParameter="0", WParameter="0")  # -> Plane, Point, Include
merge_3 = Merge(
    Data1=box_corners.CornerA,
    Data2=box_corners.CornerB,
    Data3=box_corners.CornerC,
    Data4=box_corners.CornerD,
    Data5=box_corners.CornerE,
    Data6=box_corners.CornerF,
    Data7=box_corners.CornerG,
    Data8=box_corners.CornerH)  # -> simplify(Result)
pt_4 = Point(simplify(box_5.Point))
cp = ClosestPoint(Point=merge_3, Cloud=ungroup_4)  # -> ClosestPoint, CPIndex, Distance
merge_4 = Merge(Data1=pt_4, Data2=ungroup_3)
group_7 = Group(Objects=merge_4)
smaller = SmallerThan(FirstNumber=cp.Distance, SecondNumber="0.01")  # -> SmallerThan, OrEqualTo
panel = Panel(smaller.SmallerThan)
smaller_than = ClusterOutput(smaller.SmallerThan)
O_2 = ClusterOutput(ungroup_2)
O_3 = ClusterOutput(ungroup_4)
G = ClusterOutput(group_7)

# ==== cluster Cluster2_5
pt = ClusterInput()
crv = ClusterInput()
O = ClusterInput()
crv_2 = Curve(crv)
pt_2 = Point(pt)
bbox = BoundingBox(Content=crv_2, Plane=PlaneXY(0, 0, 0), UnionBox=True)  # -> Box, Box_2

group = Group(Objects=O)
group_2 = Group(Objects=pt_2)
merge = Merge(Data1=group_2, Data2=group)
group_3 = Group(Objects=merge)

pt_3 = Point(pt_2)
box = EvaluateBox(Box=bbox.Box, UParameter=0.5, VParameter=0.5, WParameter=0.5)  # -> Plane, Point, Include
yz = YZPlane(Origin=box.Point)
xy = XYPlane(Origin=box.Point)
xz = XZPlane(Origin=box.Point)
group_4 = Group(Objects=merge)
group_5 = Group(Objects=pt_3)

# ---- group: Getting box array
box_2 = Box(bbox.Box)
box_3 = EvaluateBox(Box=box_2, UParameter="0", VParameter="0", WParameter="1")  # -> Plane, Point, Include
box_4 = EvaluateBox(Box=box_2, UParameter="0", VParameter="0", WParameter="0")  # -> Plane, Point, Include
dist = Distance(PointA=box_4.Point, PointB=box_3.Point)
multiplication = Multiplication(A=dist, B="1.5")

# ----
mirror = Mirror(Geometry=group_3, Plane=yz)  # -> Geometry, Transform
mirror_2 = Mirror(Geometry=mirror.Geometry, Plane=yz)  # -> Geometry, Transform
mirror_3 = Mirror(Geometry=mirror_2.Geometry, Plane=xy)  # -> Geometry, Transform
mirror_4 = Mirror(Geometry=mirror_3.Geometry, Plane=yz)  # -> Geometry, Transform
merge_2 = Merge(Data1=mirror.Geometry, Data2=mirror_2.Geometry, Data3=mirror_3.Geometry, Data4=mirror_4.Geometry)  # -> flatten(Result)
lng = ListLength(List=merge_2)
num = Number(multiplication)
series = Series(Start=0, Step=num, Count=lng)
Z = UnitZ(Factor=series)
group_6 = Group(Objects=crv_2)
move = Move(Geometry=merge_2, Motion=Z)  # -> Geometry, Transform
move_2 = Move(Geometry=group_6, Motion=Z)  # -> Geometry, Transform
ungroup = Ungroup(Group=move_2.Geometry)
ungroup_2 = Ungroup(Group=move.Geometry)
O_2 = ClusterOutput(ungroup)
item = ListItem(List=ungroup_2, Index=0, Wrap=True)  # -> Item, Item1
bbox_2 = BoundingBox(Content=ungroup, Plane=PlaneXY(0, 0, 0), UnionBox=True)  # -> Box, Box_2
box_5 = EvaluateBox(Box=bbox_2.Box, UParameter="0", VParameter="0", WParameter="0")  # -> Plane, Point, Include
ungroup_3 = Ungroup(Group=item.Item)  # -> simplify(Objects)
ungroup_4 = Ungroup(Group=item.Item1)  # -> simplify(Objects)
pt_4 = Point(simplify(box_5.Point))
O_3 = ClusterOutput(ungroup_3)
box_corners = BoxCorners(Box=bbox_2.Box)  # -> CornerA, CornerB, CornerC, CornerD, CornerE, CornerF, CornerG, CornerH
merge_3 = Merge(Data1=pt_4, Data2=ungroup_4)
merge_4 = Merge(
    Data1=box_corners.CornerA,
    Data2=box_corners.CornerB,
    Data3=box_corners.CornerC,
    Data4=box_corners.CornerD,
    Data5=box_corners.CornerE,
    Data6=box_corners.CornerF,
    Data7=box_corners.CornerG,
    Data8=box_corners.CornerH)  # -> simplify(Result)
group_7 = Group(Objects=merge_3)
cp = ClosestPoint(Point=merge_4, Cloud=ungroup_3)  # -> ClosestPoint, CPIndex, Distance
G = ClusterOutput(group_7)
smaller = SmallerThan(FirstNumber=cp.Distance, SecondNumber="0.01")  # -> SmallerThan, OrEqualTo
smaller_than = ClusterOutput(smaller.SmallerThan)
